# Grasshopper definition BakerTriangleRamp.gh (Grasshopper 1.0.7)
# plug-ins: Bifocals, Other Assembly

curve = Curve(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)
curve_2 = Curve(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)
ghpython_script = GhPythonScript(crv01=curve, crv02=curve_2, n=Slider(46, range=0..100))  # -> out, a, new_pt_list, edges, crv01_pl, crv02_pl; inputs n: Int32
# ---------- ghpython_script: Python ----------
import rhinoscriptsyntax as rs
import ghpythonlib.treehelpers as gt


crv01_pt_list=rs.DivideCurve(crv01,n)
crv02_pt_list=rs.DivideCurve(crv02,n)

new_pt_list=[]
edges=[]

crv01_pl=[]
crv02_pl=[]

for i in range(n):
    if i % 2==0:
        new_pt_list.append(crv01_pt_list[i])
        crv01_pl.append(crv01_pt_list[i])
    else:
        new_pt_list.append(crv02_pt_list[i])
        crv02_pl.append(crv02_pt_list[i])


for i in range(n):
    new_edge=[]
    new_srf=[]
    if i < n-3:
        pt_a=new_pt_list[i]
        pt_b=new_pt_list[i+1]
        pt_c=new_pt_list[i+2]
    tri_edge=[pt_a,pt_b,pt_c,pt_a]
    new_edge=rs.AddPolyline(tri_edge)
    edges.append(new_edge)
# ---------- end ghpython_script ----------

point = Point(ghpython_script.new_pt_list)
curve_3 = Curve(ghpython_script.edges)
point_2 = Point(ghpython_script.crv01_pl)
point_3 = Point(ghpython_script.crv02_pl)

polyline = PolyLine(Vertices=point_2, Closed=False)
polyline_2 = PolyLine(Vertices=point_3, Closed=False)
boundary_surfaces = BoundarySurfaces(Edges=curve_3)

unit_z = UnitZ(Factor=expr("12*x", Slider(3, range=0..10)))
extrude = Extrude(Base=polyline_2, Direction=unit_z)
extrude_2 = Extrude(Base=polyline, Direction=unit_z)
