# Grasshopper definition SelectSrfPareelToGround_2.gh (Grasshopper 1.0.7)

brep = Brep([<brep referenced from the Rhino model> x493])
mesh = Mesh()
deconstruct_brep = DeconstructBrep(Brep=brep)  # -> Faces, Edges, Vertices
surface = Surface(reparameterize(flatten(deconstruct_brep.Faces)))
evaluate_surface = EvaluateSurface(Surface=surface, Point="0.5,0.5")  # -> Point, Normal, UDirection, VDirection, Frame
deconstruct = Deconstruct(Point=evaluate_surface.Point)  # -> XComponent, YComponent, ZComponent

# ----
# 是否中心点z坐标在0
equality = Equality(FirstNumber=deconstruct.ZComponent, SecondNumber=0)  # -> Equality, Inequality

dispatch = Dispatch(List=surface, DispatchPattern=equality.Equality)  # -> ListA, ListB
surface_2 = Surface(dispatch.ListB)
surface_3 = Surface(dispatch.ListA)
